# Grasshopper definition rendering.gh (Grasshopper 1.0.7)
# plug-ins: PyElasticaExtension

# ----
# Master Switch
# Switches
# Data Path
# Rod Groups
# Layer Name
# Rod Periodicity
# Rendering Save Path
panel = Panel("""false
false
true""")
panel_2 = Panel("""helical_rods
straight_rods
outer_ring_rods""")
master_switch = BooleanToggle(True)
render_with_raytrace = BooleanToggle(False)
quick_bake = Button()
panel_3 = Panel("""Export1.npz
Export2.npz
Export3.npz
Export4.npz
Export5.npz
Export6.npz""")
bake = BooleanToggle(False)
or = GateOr(A=quick_bake, B=bake)
paths = CombinePath(Directory="<PathToFile>", FileName=panel_3)
npzimport_l = NpzImportLegacy(Switch=master_switch, FilePath=graft(paths), Group=panel_2, Periodic=panel)  # -> CosseratRod, Debug
bake_switch = GateAnd(A=master_switch, B=or)
render_switch = GateAnd(A=master_switch, B=render_with_raytrace)

# ----
# Animation Time (right click --> Animate)
time = Slider(90, range=0..90)

concat = Concatenate(FragmentA=graft(panel_3), FragmentC="'-'", FragmentB=panel_2)  # -> graft(Result)
cosseratrods = CosseratRods(Switch=master_switch, CosseratRod=npzimport_l.CosseratRod, Timestep=time)  # -> Rod, Debug
batchbake = BatchBake(Switch=bake_switch, LayerName=concat, ObjectList=cosseratrods.Rod)  # -> Debug, Complete
viewer = ParamViewer(concat)
# Should match!
viewer_2 = ParamViewer(cosseratrods.Rod)
and = GateAnd(B=batchbake.Complete)
re = Rendering(Switch=render_switch, FilePath="C:\Users\mattia-lab\Documents\Rhino\chshih2\rendering\", Timestep=time)  # -> Completed, Debug

# ----
# Debug / Progress Check
# File Paths
# Cosserat Rod Build
# Bake
# Render
panel_4 = Panel(paths)
panel_5 = Panel(cosseratrods.Debug)
panel_6 = Panel(batchbake.Debug)
panel_7 = Panel(re.Debug)
