# Grasshopper definition rendering_with_anemone.gh (Grasshopper 1.0.7)
# plug-ins: PyElasticaExtension, Anemone

# ----
# Master Switch
# Switches
# Data Path
# Rod Groups
# Layer Name
# Rod Periodicity
# Rendering Save Path
panel = Panel("""false
false
true""")
panel_2 = Panel("""helical_rods
straight_rods
outer_ring_rods""")
master_switch = BooleanToggle(True)
render_with_raytrace = BooleanToggle(False)
quick_bake = Button()
panel_3 = Panel("""Export1.npz
Export2.npz
Export3.npz
Export4.npz
Export5.npz
Export6.npz""")
bake = BooleanToggle(False)
or = GateOr(A=quick_bake, B=bake)
paths = CombinePath(Directory="<PathToFile>", FileName=panel_3)
npzimport_l = NpzImportLegacy(Switch=master_switch, FilePath=graft(paths), Group=panel_2, Periodic=panel)  # -> CosseratRod, Debug
bake_switch = GateAnd(A=master_switch, B=or)
render_switch = GateAnd(A=master_switch, B=render_with_raytrace)

concat = Concatenate(FragmentA=graft(panel_3), FragmentC="'-'", FragmentB=panel_2)  # -> graft(Result)
start_rendering = Button()
# Anemone Loop
total_timesteps = Repeat(150)
panel_4 = Panel(total_timesteps)
loop_start = LoopStart(Repeat=total_timesteps, Trigger=start_rendering)  # -> port, Counter, Data
cosseratrods = CosseratRods(Switch=master_switch, CosseratRod=npzimport_l.CosseratRod, Timestep=loop_start.Counter)  # -> Rod, Debug
batchbake = BatchBake(Switch=bake_switch, LayerName=concat, ObjectList=cosseratrods.Rod)  # -> Debug, Complete
viewer = ParamViewer(concat)
# Should Match!
viewer_2 = ParamViewer(cosseratrods.Rod)
int = Integer(batchbake.Complete)
mm = MassMultiplication(Input=int)  # -> Result, PartialResults
bool = Boolean(mm.Result)
and = GateAnd(A=render_switch, B=bool)
re = Rendering(Switch=and, FilePath="C:\Users\mattia-lab\Documents\Rhino\chshih2\rendering\", Timestep=loop_start.Counter)  # -> Completed, Debug

# ----
# Debug / Progress Check
# File Paths
# Cosserat Rod Build
# Bake
# Render
panel_5 = Panel(paths)
panel_6 = Panel(cosseratrods.Debug)
panel_7 = Panel(batchbake.Debug)
panel_8 = Panel(re.Debug)

loop_end = LoopEnd(
    port=loop_start.port,
    Exit=invert(master_switch),
    Data=[loop_start.Counter, re.Debug],
    TimeOutVal=0,
    pausedState=False,
    state="Constant output")
panel_9 = Panel(loop_end)
